# Dynamo graph 01_DynamoScript.dyn (Dynamo 2.6.2.15705)
# packages: PracticalBIM 2020.0.43

file_path = Filename("C:\Users\NareshDhami(WovenbyT\Desktop\Terrain Modeling\01_Terrain Points.txt")

# group: Clean Points
readText = FileSystem.ReadText(file=file_path)
code_block = CodeBlock()
# ---------- code_block.designscript (3 lines) ----------
"
";
"!";
# ----------------------------------------
replace = String.Replace(str=readText, searchFor=code_block.out0, replaceWith=code_block.out1)
split = String.Split(str=replace, separator0=code_block.out1)
trimWhitespace = String.TrimWhitespace(str=split)
code_block_2 = CodeBlock { ","; }
split_2 = String.Split(str=trimWhitespace, separator0=code_block_2)

# group: Sorting Points
transpose = List.Transpose(lists=split_2)
code_block_3 = CodeBlock { 0; 1; 2; }
getItemAtIndex = List.GetItemAtIndex(list=transpose, index=code_block_3.out0)
getItemAtIndex_2 = List.GetItemAtIndex(list=transpose, index=code_block_3.out1)
getItemAtIndex_3 = List.GetItemAtIndex(list=transpose, index=code_block_3.out2)
code_block_4 = CodeBlock(a=getItemAtIndex, b=getItemAtIndex_2, c=getItemAtIndex_3) { a+","+b+","+c+"!"; }
toNumber = String.ToNumber(str=getItemAtIndex)
toNumber_2 = String.ToNumber(str=getItemAtIndex_2)
toNumber_3 = String.ToNumber(str=getItemAtIndex_3)
list_create = List.Create(item0=code_block_4, item1=toNumber, item2=toNumber_2, item3=toNumber_3)
code_block_5 = CodeBlock { 1; 2; 3; }
sortListofListsL3 = Custom[SortListofListsL3](seq=list_create, sortIndex1=code_block_5.out0, sortIndex2=code_block_5.out1, sortIndex3=code_block_5.out2)  # package PracticalBIM; Sort Three levels of Lists by index
code_block_6 = CodeBlock(a=sortListofListsL3) { a[1]; a[2]; a[3]; }

# group: Surface Creation
minimumItem = List.MinimumItem(list=code_block_6.out0)
code_block_7 = CodeBlock(a=code_block_6.out0, b=minimumItem) { a-b; }
minimumItem_2 = List.MinimumItem(list=code_block_6.out1)
code_block_8 = CodeBlock(a=code_block_6.out1, b=minimumItem_2) { a-b; }
minimumItem_3 = List.MinimumItem(list=code_block_6.out2)
code_block_9 = CodeBlock(a=code_block_6.out2, b=minimumItem_3) { a-b; }
byCoordinates = Point.ByCoordinates(x=code_block_7, y=code_block_8, z=code_block_9)
code_block_10 = CodeBlock { 20; }
chop = List.Chop(list=byCoordinates, lengths=code_block_10)
byPoints = NurbsCurve.ByPoints(points=chop)
byLoft = Surface.ByLoft(crossSections=byPoints)

byPoints_2 = Topography.ByPoints(points=byCoordinates)

# group: Mechanical Soil Points
values_for_first_point = CodeBlock { [10,25,30,15,120]; }
values_for_second_point = CodeBlock { [75,80,85,100,130]; }
values_for_third_point = CodeBlock { [15,22,80,90,135]; }
values_for_fourth_point = CodeBlock { [12,50,55,100,140]; }
values_for_fifth_point = CodeBlock { [2,10,80,120,126]; }
random_mechanical_points = CodeBlock { [75,125,180,230,380]; }

# group: Soil Mechanics Cylinders
code_block_11 = CodeBlock(a=values_for_first_point, b=values_for_second_point, c=values_for_third_point, d=values_for_fourth_point, e=values_for_fifth_point) { [a,b,c,d,e]; }
transpose_2 = List.Transpose(lists=code_block_11)
code_block_12 = CodeBlock(a=byCoordinates, b=random_mechanical_points) { a[b]; }
code_block_13 = CodeBlock(a=code_block_11) { a*-1; }
byCoordinates_2 = Vector.ByCoordinates(z=code_block_13)
translate = Geometry.Translate(geometry=code_block_12, direction=byCoordinates_2)
addItemToFront = List.AddItemToFront(item=code_block_12@L1, list=translate@L2)
restOfItems = List.RestOfItems(list=addItemToFront@L2)
code_block_14 = CodeBlock { 5; }
byPointsRadius = Cylinder.ByPointsRadius(startPoint=addItemToFront, endPoint=restOfItems, radius=code_block_14)
count = List.Count(list=byPointsRadius@L2)
code_block_15 = CodeBlock(a=count) { 0..1..#a; }
color_range = ColorRange(value=code_block_15)  # unwired: colors, indices
byGeometryColor = Modifiers.GeometryColor.ByGeometryColor(geometry=byPointsRadius, color=color_range)

distanceTo = Geometry.DistanceTo(geometry=byCoordinates, other=code_block_12, lacing=CrossProduct)
minimumItem_4 = List.MinimumItem(list=distanceTo)
indexOf = List.IndexOf(list=distanceTo@L2, element=minimumItem_4@L1)
removeItemAtIndex = List.RemoveItemAtIndex(list=indexOf@L2, indices=distanceTo@L1)
