# Dynamo graph Compelete Topography Model.dyn "01_DynamoScript" (Dynamo 2.6.2.15705)
# packages: PracticalBIM 2020.0.43

file_path = Filename("C:\Users\NareshDhami(WovenbyT\Desktop\Terrain Modeling\01_Terrain Points.txt")

# group: Clean Points
readText = FileSystem.ReadText(file=file_path)
code_block = CodeBlock()
# ---------- code_block.designscript (3 lines) ----------
"
";
"!";
# ----------------------------------------
replace = String.Replace(str=readText, searchFor=code_block.out0, replaceWith=code_block.out1)
split = String.Split(str=replace, separator0=code_block.out1)
trimWhitespace = String.TrimWhitespace(str=split)
code_block_2 = CodeBlock { ","; }
split_2 = String.Split(str=trimWhitespace, separator0=code_block_2)

# group: Sorting Points
transpose = List.Transpose(lists=split_2)
code_block_3 = CodeBlock { 0; 1; 2; }
getItemAtIndex = List.GetItemAtIndex(list=transpose, index=code_block_3.out0)
getItemAtIndex_2 = List.GetItemAtIndex(list=transpose, index=code_block_3.out1)
getItemAtIndex_3 = List.GetItemAtIndex(list=transpose, index=code_block_3.out2)
code_block_4 = CodeBlock(a=getItemAtIndex, b=getItemAtIndex_2, c=getItemAtIndex_3) { a+","+b+","+c+"!"; }
toNumber = String.ToNumber(str=getItemAtIndex)
toNumber_2 = String.ToNumber(str=getItemAtIndex_2)
toNumber_3 = String.ToNumber(str=getItemAtIndex_3)
list_create = List.Create(item0=code_block_4, item1=toNumber, item2=toNumber_2, item3=toNumber_3)
code_block_5 = CodeBlock { 1; 2; 3; }
sortListofListsL3 = Custom[SortListofListsL3](seq=list_create, sortIndex1=code_block_5.out0, sortIndex2=code_block_5.out1, sortIndex3=code_block_5.out2)  # package PracticalBIM; Sort Three levels of Lists by index
code_block_6 = CodeBlock(a=sortListofListsL3) { a[1]; a[2]; a[3]; }

# group: Surface Creation
minimumItem = List.MinimumItem(list=code_block_6.out0)
code_block_7 = CodeBlock(a=code_block_6.out0, b=minimumItem) { a-b; }
minimumItem_2 = List.MinimumItem(list=code_block_6.out1)
code_block_8 = CodeBlock(a=code_block_6.out1, b=minimumItem_2) { a-b; }
minimumItem_3 = List.MinimumItem(list=code_block_6.out2)
code_block_9 = CodeBlock(a=code_block_6.out2, b=minimumItem_3) { a-b; }
byCoordinates = Point.ByCoordinates(x=code_block_7, y=code_block_8, z=code_block_9)
code_block_10 = CodeBlock { 20; }
chop = List.Chop(list=byCoordinates, lengths=code_block_10)
byPoints = NurbsCurve.ByPoints(points=chop)
byLoft = Surface.ByLoft(crossSections=byPoints)

byPoints_2 = Topography.ByPoints(points=byCoordinates)

# group: Mechanical Soil Points
random_mechanical_points = CodeBlock { [75,125,180,230,380]; }
values_for_first_point = CodeBlock { [10,25,30,15,120]; }
values_for_second_point = CodeBlock { [75,80,85,100,130]; }
values_for_third_point = CodeBlock { [15,22,80,90,135]; }
values_for_fourth_point = CodeBlock { [12,50,55,100,140]; }
values_for_fifth_point = CodeBlock { [2,10,80,120,126]; }

# group: Soil Mechanics Cylinders
code_block_11 = CodeBlock(a=byCoordinates, b=random_mechanical_points) { a[b]; }
code_block_12 = CodeBlock(a=values_for_first_point, b=values_for_second_point, c=values_for_third_point, d=values_for_fourth_point, e=values_for_fifth_point) { [a,b,c,d,e]; }
code_block_13 = CodeBlock(a=code_block_12) { a*-1; }
byCoordinates_2 = Vector.ByCoordinates(z=code_block_13)
translate = Geometry.Translate(geometry=code_block_11, direction=byCoordinates_2)
addItemToFront = List.AddItemToFront(item=code_block_11@L1, list=translate@L2)
restOfItems = List.RestOfItems(list=addItemToFront@L2)
code_block_14 = CodeBlock { 5; }
byPointsRadius = Cylinder.ByPointsRadius(startPoint=addItemToFront, endPoint=restOfItems, radius=code_block_14)
count = List.Count(list=byPointsRadius@L2)
code_block_15 = CodeBlock(a=count) { 0..1..#a; }
color_range = ColorRange(value=code_block_15)  # unwired: colors, indices
byGeometryColor = Modifiers.GeometryColor.ByGeometryColor(geometry=byPointsRadius, color=color_range)
transpose_2 = List.Transpose(lists=translate)

# group: Closest Soil Mechanical Points
distanceTo = Geometry.DistanceTo(geometry=byCoordinates, other=code_block_11, lacing=CrossProduct)
minimumItem_4 = List.MinimumItem(list=distanceTo)
indexOf = List.IndexOf(list=distanceTo@L2, element=minimumItem_4@L1)
removeItemAtIndex = List.RemoveItemAtIndex(list=distanceTo@L2, indices=indexOf@L1)
minimumItem_5 = List.MinimumItem(list=removeItemAtIndex)
indexOf_2 = List.IndexOf(list=removeItemAtIndex@L2, element=minimumItem_5@L1)
removeItemAtIndex_2 = List.RemoveItemAtIndex(list=removeItemAtIndex@L2, indices=indexOf_2@L1)
minimumItem_6 = List.MinimumItem(list=removeItemAtIndex_2)
indexOf_3 = List.IndexOf(list=removeItemAtIndex@L2, element=minimumItem_6@L1)
code_block_16 = CodeBlock(a=minimumItem_4, b=minimumItem_4, c=minimumItem_6) { a+b+c; }
code_block_17 = CodeBlock(b=code_block_16, a=minimumItem_6) { b-a; }
code_block_18 = CodeBlock(b=code_block_16, a=minimumItem_4) { b-a; }
code_block_19 = CodeBlock(b=code_block_16, a=minimumItem_5) { b-a; }
code_block_20 = CodeBlock(a=code_block_18, b=code_block_19, c=code_block_17) { a+b+c; }
code_block_21 = CodeBlock(a=code_block_17, b=code_block_20) { a/b; }
code_block_22 = CodeBlock(a=code_block_18, b=code_block_20) { a/b; }
code_block_23 = CodeBlock(a=code_block_19, b=code_block_20) { a/b; }

# group: Comparatives
code_block_24 = CodeBlock { 2; }
round = Math.Round(number=code_block_21, digits=code_block_24)
round_2 = Math.Round(number=code_block_22, digits=code_block_24)
code_block_25 = CodeBlock { 0.30; }
ge = round_2 >= code_block_25
code_block_26 = CodeBlock { 0.6; 1; }
remapRange = Math.RemapRange(numbers=round_2, newMin=code_block_26.out0, newMax=code_block_26.out1)
if_ = If(test=ge, true=remapRange, false=round_2)
round_3 = Math.Round(number=code_block_23, digits=code_block_24)
code_block_27 = CodeBlock(a=if_) { 1-a; }
ge_2 = round_3 >= code_block_27
if_2 = If(test=ge_2, true=code_block_27, false=round_3)
code_block_28 = CodeBlock(a=if_, b=if_2) { 1-a-b; }

# group: Points Creation
X = Point.X(point=byCoordinates)
Y = Point.Y(point=byCoordinates)
Z = Point.Z(point=transpose_2)
getItemAtIndex_4 = List.GetItemAtIndex(list=Z@L2, index=indexOf)
mul = getItemAtIndex_4@L2 * if_
indexOf_4 = List.IndexOf(list=distanceTo@L2, element=minimumItem_5@L1)
getItemAtIndex_5 = List.GetItemAtIndex(list=Z@L2, index=indexOf_4)
mul_2 = getItemAtIndex_5@L2 * if_2
indexOf_5 = List.IndexOf(list=distanceTo@L2, element=minimumItem_6@L1)
getItemAtIndex_6 = List.GetItemAtIndex(list=Z@L2, index=indexOf_5)
mul_3 = getItemAtIndex_6@L2 * code_block_28
code_block_29 = CodeBlock(a=mul, b=mul_2, c=mul_3) { a+b+c; }

Z_2 = Point.Z(point=byCoordinates)

# group: Cuboid Creation
watch = Watch(X)
minimumItem_7 = List.MinimumItem(list=watch)
watch_2 = Watch(X)
minimumItem_8 = List.MinimumItem(list=watch_2)
watch_3 = Watch(Z_2)
minimumItem_9 = List.MinimumItem(list=watch_3)
code_block_30 = CodeBlock(a=minimumItem_9) { a-160; }
byCoordinates_3 = Point.ByCoordinates(x=minimumItem_7, y=minimumItem_8, z=code_block_30)
maximumItem = List.MaximumItem(list=watch)
maximumItem_2 = List.MaximumItem(list=watch_2)
maximumItem_3 = List.MaximumItem(list=watch_3)
code_block_31 = CodeBlock(a=maximumItem_3) { a+20; }
byCoordinates_4 = Point.ByCoordinates(x=maximumItem, y=maximumItem_2, z=code_block_31)
byCorners = Cuboid.ByCorners(lowPoint=byCoordinates_3, highPoint=byCoordinates_4)

split_3 = Geometry.Split(geometry=byCorners, other=byLoft)
code_block_32 = CodeBlock(a=split_3) { a[0]; }

# group: Surface Creation
code_block_33 = CodeBlock(a=code_block_29) { a[0]; }
byCoordinates_5 = Point.ByCoordinates(x=X, y=Y, z=code_block_33)
code_block_34 = CodeBlock { 20; }
chop_2 = List.Chop(list=byCoordinates_5, lengths=code_block_34)
byPoints_3 = NurbsCurve.ByPoints(points=chop_2)
byLoft_2 = Surface.ByLoft(crossSections=byPoints_3)

split_4 = Geometry.Split(geometry=code_block_32, other=byLoft_2)
code_block_35 = CodeBlock(a=split_4) { a[1]; }

# group: Surface Creation
code_block_36 = CodeBlock(a=code_block_29) { a[1]; }
byCoordinates_6 = Point.ByCoordinates(x=X, y=Y, z=code_block_36)
code_block_37 = CodeBlock { 20; }
chop_3 = List.Chop(list=byCoordinates_6, lengths=code_block_37)
byPoints_4 = NurbsCurve.ByPoints(points=chop_3)
byLoft_3 = Surface.ByLoft(crossSections=byPoints_4)

# group: Spliting Volumes
code_block_38 = CodeBlock(a=split_4) { a[0]; }
split_5 = Geometry.Split(geometry=code_block_38, other=byLoft_3)
code_block_39 = CodeBlock(a=split_5) { a[1]; }

# group: Surface Creation
code_block_40 = CodeBlock(a=code_block_29) { a[2]; }
byCoordinates_7 = Point.ByCoordinates(x=X, y=Y, z=code_block_40)
code_block_41 = CodeBlock { 20; }
chop_4 = List.Chop(list=byCoordinates_7, lengths=code_block_41)
byPoints_5 = NurbsCurve.ByPoints(points=chop_4)
byLoft_4 = Surface.ByLoft(crossSections=byPoints_5)

# group: Spliting Volumes
code_block_42 = CodeBlock(a=split_5) { a[0]; }
split_6 = Geometry.Split(geometry=code_block_42, other=byLoft_4)
code_block_43 = CodeBlock(a=split_6) { a[1]; }

# group: Surface Creation
code_block_44 = CodeBlock(a=code_block_29) { a[3]; }
byCoordinates_8 = Point.ByCoordinates(x=X, y=Y, z=code_block_44)
code_block_45 = CodeBlock { 20; }
chop_5 = List.Chop(list=byCoordinates_8, lengths=code_block_45)
byPoints_6 = NurbsCurve.ByPoints(points=chop_5)
byLoft_5 = Surface.ByLoft(crossSections=byPoints_6)

# group: Spliting Volumes
code_block_46 = CodeBlock(a=split_6) { a[0]; }
split_7 = Geometry.Split(geometry=code_block_46, other=byLoft_5)
code_block_47 = CodeBlock(a=split_7) { a[1]; }

# group: Surface Creation
code_block_48 = CodeBlock(a=code_block_29) { a[4]; }
byCoordinates_9 = Point.ByCoordinates(x=X, y=Y, z=code_block_48)
code_block_49 = CodeBlock { 20; }
chop_6 = List.Chop(list=byCoordinates_9, lengths=code_block_49)
byPoints_7 = NurbsCurve.ByPoints(points=chop_6)
byLoft_6 = Surface.ByLoft(crossSections=byPoints_7)

# group: Spliting Volumes
code_block_50 = CodeBlock(a=split_7) { a[0]; }
split_8 = Geometry.Split(geometry=code_block_50, other=byLoft_6)
code_block_51 = CodeBlock(a=split_8) { a[1]; }

# group: Final Site Works and Color Pattern
list_create_2 = List.Create(item0=code_block_35, item1=code_block_39, item2=code_block_43, item3=code_block_47, item4=code_block_51)
code_block_52 = CodeBlock { 100; }
code_block_53 = CodeBlock { 200; }
byARGB = Color.ByARGB(a=code_block_52, r=code_block_53)
byARGB_2 = Color.ByARGB(a=code_block_52, g=code_block_53)
byARGB_3 = Color.ByARGB(a=code_block_52, b=code_block_53)
list_create_3 = List.Create(item0=byARGB, item1=byARGB_2, item2=byARGB_3)
code_block_54 = CodeBlock { [0,0.5,1]; }
code_block_55 = CodeBlock { 0..1..#5; }
color_range_2 = ColorRange(colors=list_create_3, indices=code_block_54, value=code_block_55)
byGeometryColor_2 = Modifiers.GeometryColor.ByGeometryColor(geometry=list_create_2, color=color_range_2)
categories = Categories("OST_GenericModel")
code_block_56 = CodeBlock { "Site 1"; "Site 2"; "Site 3"; "Site 4"; "Site 5"; }
list_create_4 = List.Create(item0=code_block_56.out4, item1=code_block_56.out1, item2=code_block_56.out2, item3=code_block_56.out3, item4=code_block_56.out0)
byName = Material.ByName(name=list_create_4)
code_block_57 = CodeBlock { "Mechanical Volume"; }
byGeometry = DirectShape.ByGeometry(geometry=list_create_2, category=categories, material=byName, name=code_block_57)
code_block_58 = CodeBlock { "Volume"; }
volume = Solid.Volume(solid=list_create_2)
setParameterByName = Element.SetParameterByName(element=byGeometry, parameterName=code_block_58, value=volume)
